# Grasshopper definition xmlTest.ghx (Grasshopper 1.0.7)

panel = Panel("grasshopper(.ghx) meets Git!")
multiplication = Multiplication(A="8", B="3")
sph = Sphere(Base=PlaneXY(0, 0, 0), Radius=multiplication)
